# Grasshopper definition GH_Cup.ghx (Grasshopper 1.0.7)
# plug-ins: Speckle 2, TT Toolbox

panel = Panel("D:/2022/FIATLUX_Implementation/NotebooksPluto/ToyExampleV1/optimizedDataForGH.csv")
toggle = BooleanToggle(True)
path = FilePath(panel)

# ----
# SimpleExample
# Receiving data created with python script
# enclosed within julia notebook
panel_2 = Panel("https://speckle.xyz/streams/834e9dc3f1/")
receive = Receive(
    Stream=panel_2,
    AutoReceive=True,
    CurrentComponentState="up_to_date",
    ExpandOutput=True,
    LastInfoMessage="Jean-Pierre Brasile @ 2022-07-07T18:45:06.214Z: Automatic commit created the python starter example (id:a636a8926b)",
    ReceiveOnOpen=False,
    ReceivedCommitId="a636a8926b",
    StreamWrapper="https://speckle.xyz/streams/834e9dc3f1",
    selectedKitName="Objects")  # -> Info, DataFromClient, Épaisseur, Point, Units, Volume
panel_3 = Panel(receive.Épaisseur)
pt = Point(receive.Point)

readxl = ReadExcelSheet(Run=toggle, FilePath=path, Worksheet="1", Listen=toggle)  # -> UserMessages, Columns, Rows
radius = ListItem(List=readxl.Rows, Index=Slider(1, range=1..5), Wrap=True)
panel_4 = Panel(readxl.Rows)
panel_5 = Panel(radius)
height = ListItem(List=readxl.Rows, Index=Slider(2, range=0..5), Wrap=True)

height_2 = Slider(100, range=0..200)
pt_2 = Point(Point(0, 0, 0))
thickness = Slider(8, range=0..20)
Z = UnitZ(Factor=height)
Z_2 = UnitZ(Factor=receive.Épaisseur)
move = Move(Geometry=pt_2, Motion=Z)  # -> Geometry, Transform
subtraction = Subtraction(A=panel_5, B=receive.Épaisseur)
move_2 = Move(Geometry=pt_2, Motion=Z_2)  # -> Geometry, Transform
subtraction_2 = Subtraction(A=panel_5, B=receive.Épaisseur)
cir = Circle(Plane=move.Geometry, Radius=subtraction_2)
cir_2 = Circle(Plane=move.Geometry, Radius=panel_5)
cir_3 = Circle(Plane=pt_2, Radius=panel_5)
cir_4 = Circle(Plane=move_2.Geometry, Radius=subtraction)
boundary = BoundarySurfaces(Edges=cir_3)
loft = Loft(
    Curves=[cir_3, cir_2, cir, cir_4],
    Options={Adjust=False, Closed=False, LoftEnds=0, LoftSimp=0, LoftType=3, Rebuild=10, Refit=0.01})
boundary_2 = BoundarySurfaces(Edges=cir_4)
list = Accounts(
    {"No account selected": , "Account (jp.brasile@gmail.com | https://speckle.xyz)": "b416f52ba5"}, selected="Account (jp.brasile@gmail.com | https://speckle.xyz)",
    selectedId="b416f52ba5",
    selectedServer="https://speckle.xyz")
join = BrepJoin(Breps=[loft, boundary, boundary_2])  # -> Breps, Closed
id_19bbef82bc = CreateStream(Account=list, stream="19bbef82bc https://speckle.xyz b416f52ba5")
send = Send(
    Stream=id_19bbef82bc,
    Data=join.Breps,
    AutoSend=True,
    BaseId="d694b3bb86db9f461aa2988387efff51",
    CurrentComponentState="up_to_date",
    KitName="Objects",
    OutputWrappers="https://speckle.xyz\t19bbef82bc\tcabee183ac",
    UseDefaultCache=True,
    selectedKitName="Objects")
receive_2 = Receive(
    Stream=id_19bbef82bc,
    AutoReceive=True,
    CurrentComponentState="up_to_date",
    ExpandOutput=True,
    LastInfoMessage="Jean-Pierre Brasile @ 2022-07-07T18:47:57.979Z: Pushed 3 elements from Grasshopper. (id:cabee183ac)",
    ReceiveOnOpen=False,
    ReceivedCommitId="cabee183ac",
    StreamWrapper="https://speckle.xyz/streams/19bbef82bc?u=b416f52ba5",
    selectedKitName="Objects")  # -> Info, Data
panel_6 = Panel(id_19bbef82bc)
panel_7 = Panel(receive_2.Data)

panel_8 = Panel(receive.Volume)
panel_9 = Panel(["\"data from client\"", panel_3, panel_8])
id_19bbef82bc_2 = CreateStream(Account=list, stream="19bbef82bc https://speckle.xyz b416f52ba5")
send_2 = Send(
    Stream=id_19bbef82bc_2,
    Data=panel_9,
    AutoSend=True,
    BaseId="cba6fea9023af4a5042b7f37d8cc5e9e",
    CurrentComponentState="sending",
    KitName="Objects",
    OutputWrappers="https://speckle.xyz\t19bbef82bc\tce8287efee",
    UseDefaultCache=True,
    selectedKitName="Objects")
panel_10 = Panel(send_2)
