# Grasshopper definition ToyExampleV2.ghx (Grasshopper 1.0.7)
# plug-ins: Speckle 2

# ----
# Envoi via Speckle de l'objet 3D
# (id du stream automatiquement créé)
# cet id est à transmettre à qui doit récupérer l'objet). Par exemple le client de la requête initiale)
# Modélisation paramétrique du verre
# Réception des données produite par le script julia (stream 36b6a4554d)
panel = Panel("https://speckle.xyz/streams/5cd63d05d1")
receive = Receive(
    Stream=panel,
    AutoReceive=False,
    CurrentComponentState="up_to_date",
    ExpandOutput=True,
    LastInfoMessage="Jean-Pierre Brasile @ 2022-07-18T06:58:32.131Z: result of optimization (id:3e56ae7528)",
    ReceiveOnOpen=False,
    ReceivedCommitId="3e56ae7528",
    StreamWrapper="https://speckle.xyz/streams/5cd63d05d1",
    selectedKitName="Objects")  # -> Info, Height, Radius, Thickness, Units
pt = Point(Point(0, 0, 0))

num = Number(receive.Thickness)
panel_2 = Panel([receive.Height, receive.Radius, receive.Thickness])
num_2 = Number(receive.Height)
num_3 = Number(receive.Radius)

subtraction = Subtraction(A=num_3, B=num)
Z = UnitZ(Factor=num)
height = ListItem(List=num_2, Index=num, Wrap=True)
Z_2 = UnitZ(Factor=height)
point_z_e = Move(Geometry=pt, Motion=Z)  # -> Geometry, Transform
point_à_z = Move(Geometry=pt, Motion=Z_2)  # -> Geometry, Transform
cercle_r_z_0 = Circle(Plane=pt, Radius=num_3)
cercle_r_e_z_e = Circle(Plane=point_z_e.Geometry, Radius=subtraction)
r_z_h = Circle(Plane=point_à_z.Geometry, Radius=num_3)
cercle_z_r_e = Circle(Plane=point_à_z.Geometry, Radius=subtraction)
boundary = BoundarySurfaces(Edges=cercle_r_e_z_e)
loft = Loft(
    Curves=[cercle_z_r_e, cercle_r_e_z_e],
    Options={Adjust=False, Closed=False, LoftEnds=0, LoftSimp=0, LoftType=3, Rebuild=10, Refit=0.01})
boundary_2 = BoundarySurfaces(Edges=cercle_r_z_0)
loft_2 = Loft(
    Curves=[r_z_h, cercle_z_r_e],
    Options={Adjust=False, Closed=False, LoftEnds=0, LoftSimp=0, LoftType=3, Rebuild=10, Refit=0.01})
loft_3 = Loft(
    Curves=[r_z_h, cercle_r_z_0],
    Options={Adjust=False, Closed=False, LoftEnds=0, LoftSimp=0, LoftType=3, Rebuild=10, Refit=0.01})
join = BrepJoin(Breps=[loft, boundary, boundary_2, loft_3, loft_2])  # -> Breps, Closed
send = Send(
    Stream="https://speckle.xyz/streams/c9b24bc2de",
    Data=join.Breps,
    AutoSend=True,
    BaseId="a30d45ec342dc8fea05284d88718e3da",
    CurrentComponentState="up_to_date",
    KitName="Objects",
    OutputWrappers="https://speckle.xyz\tc9b24bc2de\t8204039c5b",
    UseDefaultCache=True,
    selectedKitName="Objects")
panel_3 = Panel(send)
