# Grasshopper definition SpeckleSendReceived.gh (Grasshopper 1.0.7)
# plug-ins: Speckle 2

# ----
# Click to "receive !" or
# right click and "receive automatically"
# Click to "send !" or right click
#  to send automatically
# Send/Receive remote
panel = Panel("https://speckle.xyz/streams/84c21a2025")
receive = Receive(
    Stream=panel,
    AutoReceive=False,
    CurrentComponentState="up_to_date",
    ExpandOutput=True,
    LastInfoMessage="Jean-Pierre Brasile @ 2022-06-24T09:30:40.168Z: Pushed 1 elements from Grasshopper. (id:e0fbb54b93)",
    ReceiveOnOpen=False,
    ReceivedCommitId="e0fbb54b93",
    StreamWrapper="https://speckle.xyz/streams/84c21a2025",
    selectedKitName="Objects")  # -> Info, Data
send = Send(
    Stream=panel,
    Data="45",
    AutoSend=False,
    BaseId="3d25fa8a37f23f23b5bdcf71b9539473",
    CurrentComponentState="up_to_date",
    KitName="Objects",
    OutputWrappers="https://speckle.xyz\t84c21a2025\te0fbb54b93",
    UseDefaultCache=True,
    selectedKitName="Objects")
panel_2 = Panel(receive.Data)

ls = LocalSender(Data="33", selectedKitName="Objects")
panel_3 = Panel(ls)
lr = LocalReceive(LocalDataId=ls, selectedKitName="Objects")
eso = ExpandSpeckleObject(SpeckleObject=lr, selectedKitName="Objects")
panel_4 = Panel(eso)
